# Grasshopper definition HelloWorld_Grid_GroupName.ghx (Grasshopper 0.9.76)

# ---- group: Generate Grid
series = Series(Start=0, Step=Slider(10, range=0..10), Count=10)
pt = ConstructPoint(XCoordinate=series, YCoordinate=graft(series), ZCoordinate=0)  # -> flatten(Point)

# ---- group: Create Circles
cir = Circle(Plane=pt, Radius=Slider(5, range=0..10))
